# Grasshopper definition Water-oriented City.gh (Grasshopper 1.0.7)

panel = Panel("""10.2954
40.6056""")
item = ListItem(List=panel, Index=0, Wrap=True)  # -> Item, Item1
gismo = Gismo_Gismo(gismoFolder="c:\gismo")  # -> readMe; plug-in component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
createlocation = Gismo_CreateLocation(locationName="unknown location", latitude=item.Item, longitude=item.Item1)  # -> location; plug-in component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
terraingenerator = Gismo_TerrainGenerator(
    location=createlocation,
    radius=Slider(3000, range=0..10000),
    source=0,
    type=2,
    standThickness=0,
    numOfContours=10,
    bakeIt=False,
    runIt=Toggle(True))  # -> readMe, terrain, origin, elevation, elevationContours, title; inputs radius: Int32, source: Int32, type: Int32, origin: Point3d, numOfContours: Int32, legendBakePar: tree, bakeIt: Boolean, runIt: Boolean; plug-in component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
osmshapes = Gismo_OSMShapes(
    location=createlocation,
    radius=Slider(1000, range=0..1000),
    shapeType=Slider(0, range=0..1),
    bakeIt=False,
    runIt=Toggle(True))  # -> readMe, shapes, keys, values, port, titleOriginPt, title; inputs radius: Int32, origin: Point3d, shapeType: Int32, requiredKeys: list, onlyRemove_Ids: tree, bakeIt: Boolean, runIt: Boolean; plug-in component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
panel_2 = Panel(osmshapes.readMe)
